# Grasshopper definition multiLayerArt.gh (Grasshopper 1.0.7)

crv = Curve([<curve referenced from the Rhino model> x5])
cls = Closed(Curve=crv)  # -> Closed, Periodic
cull = CullPattern(List=crv, CullPattern=cls.Closed)
area = Area(Geometry=cull)  # -> Area, Centroid
larger = LargerThan(FirstNumber=area.Area, SecondNumber=Slider(53, range=0..2000))  # -> LargerThan, OrEqualTo
cull_2 = CullPattern(List=cull, CullPattern=larger.LargerThan)
frame = Curve(<curve referenced from the Rhino model>)
offset = OffsetCurve(Curve=frame, Distance=Slider(10, range=0..10), Corners=1)
item = ListItem(List=cull_2, Index=Slider(2, range=0..10), Wrap=True)
item_2 = ListItem(List=cull_2, Index=Slider(3, range=0..10), Wrap=True)
cull_i = CullIndex(List=cull_2, Indices=Slider(0, range=0..100), Wrap=True)
frame_2 = BoundarySurfaces(Edges=flatten([frame, offset]))
group = Group(Objects=[item, item_2])
bbox = BoundingBox(Content=cull_i, Plane=PlaneXY(0, 0, 0))  # -> Box, Box_2
number_slider = Slider(20, range=0..100)
boundary = BoundarySurfaces(Edges=frame)
rectangle = Rectangle(Plane=PlaneXY(0, 0, 0), XSize=number_slider, YSize=number_slider, Radius=0)  # -> Rectangle, Length
vec = VectorXYZ(XComponent=50, YComponent=0, ZComponent=0)  # -> Vector, Length
tab = Move(Geometry=rectangle.Rectangle, Motion=vec.Vector)  # -> Geometry, Transform
runion = RegionUnion(Curves=[tab.Geometry, item])
boundary_2 = BoundarySurfaces(Edges=[runion, offset])
sdiff = SolidDifference(BrepsA=boundary_2, BrepsB=boundary)
brep = Brep(sdiff)
edges = BrepEdges(Brep=brep)  # -> Naked, Interior, NonManifold
